# Grasshopper definition Daylight_simulation.gh (Grasshopper 1.0.7)

ladybug = Ladybug_Ladybug()  # -> Vviiiiiiiiiizzz; plug-in component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
honeybee = Honeybee_Honeybee()  # -> Vviiiiiiiiiizzz; plug-in component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
number_slider = Slider(2.7, range=0..10)
number_slider_2 = Slider(4.5, range=4.5..6.5)
# Convert the box to Honeybee zone
# All the material will be set to default
# In case you want to change them search
# for Honeybee_Set Radiance Materials
# component.
number_slider_3 = Slider(2.7, range=0..10)

# ----
# Create shadings
number_slider_4 = Slider(0.6, range=0.3..0.6)
number_slider_5 = Slider(2.65, range=0..10)
pt = ConstructPoint(XCoordinate=0, YCoordinate=expr("-x", number_slider_4), ZCoordinate=0)
xz = XZPlane(Origin=Point(0, 0, 0))
pt_2 = ConstructPoint(XCoordinate=0, YCoordinate=0, ZCoordinate=0)
pt_3 = ConstructPoint(XCoordinate=number_slider_5, YCoordinate=0, ZCoordinate=number_slider_3)
xz_2 = XZPlane(Origin=pt)
pt_4 = ConstructPoint(XCoordinate=0, YCoordinate=expr("-x", number_slider_4), ZCoordinate=0)
pt_5 = ConstructPoint(XCoordinate=number_slider_5, YCoordinate=expr("-x", number_slider_4), ZCoordinate=number_slider_3)
rec_2pt = Rectangle2Pt(Plane=xz, PointA=pt_2, PointB=pt_3, Radius=0)  # -> Rectangle, Length
rec_2pt_2 = Rectangle2Pt(Plane=xz_2, PointA=pt_4, PointB=pt_5, Radius=0)  # -> Rectangle, Length
boundary = BoundarySurfaces(Edges=rec_2pt.Rectangle)
boundary_2 = BoundarySurfaces(Edges=rec_2pt_2.Rectangle)
sdivide = DivideSurface(Surface=boundary, UCount="5", VCount="1")  # -> Points, Normals, Parameters
sdivide_2 = DivideSurface(Surface=boundary_2, UCount="5", VCount="1")  # -> Points, Normals, Parameters
split = SplitList(List=sdivide.Points, Index="1")  # -> ListA, ListB
split_2 = SplitList(List=sdivide_2.Points, Index="1")  # -> ListA, ListB
yz = YZPlane(Origin=split.ListA)
number_slider_6 = Slider(0.3, range=0..1)
rec_2pt_3 = Rectangle2Pt(Plane=yz, PointA=split.ListA, PointB=split_2.ListB, Radius=0)  # -> Rectangle, Length
boxrec = BoxRectangle(Rectangle=rec_2pt_3.Rectangle, Height=Slider(0.05, range=0..0.1))
mass2zone = Honeybee_Masses2Zones(zoneMasses=flatten(boxrec), maxRoofAngle=30, createHBZones=Toggle(True))  # -> readMe, HBZones; plug-in component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
radopaquematerial = Honeybee_RadianceOpaqueMaterial(
    materialName="Shading",
    RReflectance=number_slider_6,
    GReflectance=number_slider_6,
    BReflectance=number_slider_6,
    roughness=0.05,
    specularity=0)  # -> avrgRef, RADMaterial; plug-in component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
wires = BrepWireframe(Brep=boxrec, Density=-1)
setradmaterials = Honeybee_SetRadianceMaterials(
    HBObject=mass2zone.HBZones,
    wallRADMaterial=radopaquematerial.RADMaterial,
    windowRADMaterial=radopaquematerial.RADMaterial,
    roofRADMaterial=radopaquematerial.RADMaterial,
    floorRADMaterial=radopaquematerial.RADMaterial,
    ceilingRADMaterial=radopaquematerial.RADMaterial)  # -> simplify(modifiedHBObject); plug-in component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

# ----
# Add EP Construction materials
# for the window
panel = Panel("Glass")
epglassmat = Honeybee_EnergyPlusGlassMaterial(name=panel, thickness="0.004", solarTransmittance="0.7")  # -> EPMaterial; plug-in component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
epwindowairgap = Honeybee_EnergyPlusWindowAirGap(name="Air gap", thickness="0.012")  # -> EPMaterial; plug-in component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
epconstruction = Honeybee_EnergyPlusConstruction(name="Window", layer_1=epglassmat, layer_2=epwindowairgap, layer_3=epglassmat)  # -> EPConstruction; plug-in component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

box = DomainBox(Base=PlaneXY(0, 0, 0), X=number_slider, Y=number_slider_2, Z=number_slider_3)
mass2zone_2 = Honeybee_Masses2Zones(zoneMasses=flatten(box), isConditioned=True, maxRoofAngle=30, createHBZones=Toggle(True))  # -> readMe, HBZones; plug-in component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

# ----
# Add radiance materials
# for the walls
panel_2 = Panel("Floor")
number_slider_7 = Slider(0.3, range=0..1)
number_slider_8 = Slider(0.7, range=0..1)
number_slider_9 = Slider(0.5, range=0..1)
radopaquematerial_2 = Honeybee_RadianceOpaqueMaterial(
    materialName="Ceiling",
    RReflectance=number_slider_8,
    GReflectance=number_slider_8,
    BReflectance=number_slider_8,
    roughness=0.05,
    specularity=0)  # -> avrgRef, RADMaterial; plug-in component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
radopaquematerial_3 = Honeybee_RadianceOpaqueMaterial(
    materialName="Wall",
    RReflectance=number_slider_9,
    GReflectance=number_slider_9,
    BReflectance=number_slider_9,
    roughness=0.05,
    specularity=0)  # -> avrgRef, RADMaterial; plug-in component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
radopaquematerial_4 = Honeybee_RadianceOpaqueMaterial(
    materialName=panel_2,
    RReflectance=number_slider_7,
    GReflectance=number_slider_7,
    BReflectance=number_slider_7,
    roughness=0.05,
    specularity=0)  # -> avrgRef, RADMaterial; plug-in component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
setradmaterials_2 = Honeybee_SetRadianceMaterials(
    HBObject=mass2zone_2.HBZones,
    wallRADMaterial=radopaquematerial_3.RADMaterial,
    floorRADMaterial=radopaquematerial_4.RADMaterial,
    ceilingRADMaterial=radopaquematerial_2.RADMaterial)  # -> simplify(modifiedHBObject); plug-in component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

# ----
# Add glazing based on percentage
# In case you want to add custom windows
# use Honeybee_addHBGlz component.
number_slider_10 = Slider(0.65, range=0.4..0.65)
glzparamlist = Honeybee_GlazingParametersList(northGlzParam=0, westGlzParam=0, southGlzParam=number_slider_10, eastGlzParam=0)  # -> glzParamList; plug-in component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
glazingcreator = Honeybee_GlazingBasedOnRatio(
    HBObjects=setradmaterials_2,
    glzRatio=glzparamlist,
    windowHeight=Slider(1.8, range=0..1.8),
    sillHeight=Slider(0.9, range=0..1),
    EPConstructions=epconstruction,
    runIt=Toggle(True))  # -> readMe, HBObjWGLZ; plug-in component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

# ----
# Create ground in front of the room
# for more accurate analysis
number_slider_11 = Slider(0.2, range=0..1)
pt_6 = ConstructPoint(XCoordinate=number_slider, YCoordinate=expr("-x", number_slider_2), ZCoordinate=0)
pt_7 = ConstructPoint(XCoordinate=0, YCoordinate=0, ZCoordinate=0)
rec_2pt_4 = Rectangle2Pt(Plane=PlaneXY(0, 0, 0), PointA=pt_7, PointB=pt_6, Radius=0)  # -> Rectangle, Length
radopaquematerial_5 = Honeybee_RadianceOpaqueMaterial(
    materialName="External Floor",
    RReflectance=number_slider_11,
    GReflectance=number_slider_11,
    BReflectance=number_slider_11,
    roughness=0.05,
    specularity=0)  # -> avrgRef, RADMaterial; plug-in component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
boundary_3 = BoundarySurfaces(Edges=rec_2pt_4.Rectangle)
wires_2 = BrepWireframe(Brep=boundary_3, Density=-1)
createhbsrfs = Honeybee_createHBSrfs(geometry=boundary_3, RADMaterial=radopaquematerial_5.RADMaterial)  # -> readMe, simplify(HBSurface); plug-in component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

# ----
# Occupancy schedule
panel_3 = Panel("""0
0
0
0
0
0
0
0
0
0
0
0
0
0
0
0
0
0
0
0
0
0
0
0""")
panel_4 = Panel("""0
0
0
0
0
0
0
1
1
1
1
1
1
1
1
1
1
1
0
0
0
0
0
0""")
annualschedule = Honeybee_AnnualSchedule(
    sun=panel_3,
    mon=panel_4,
    tue=panel_4,
    wed=panel_4,
    thu=panel_4,
    fri=panel_4,
    sat=panel_3,
    scheduleName="Occupancy office",
    runIt=Toggle(True))  # -> readMe, port, schedule, port_2, weekSched, schedIDFText; plug-in component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

# ---- group: HB Zone With Glazing
brep = Brep(glazingcreator.HBObjWGLZ)

# ----
panel_5 = Panel("https://energyplus.net/weather-download/europe_wmo_region_6/FRA//FRA_Paris.Orly.071490_IWEC/all")
genhbzonetestpts = Honeybee_GenerateZoneTestPoints(HBZone=brep, gridSize=Slider(0.3, range=0..1), distBaseSrf=Slider(0.7, range=0..1), moveTestMesh=Toggle(True))  # -> readMe, simplify(testPoints), simplify(ptsVectors), simplify(facesArea), simplify(mesh); plug-in component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
wires_3 = BrepWireframe(Brep=brep, Density=-1)
# Paris Orly Weather File
epw_stat = Ladybug_OpenEPWAndSTATWeatherFiles(weatherFileURL=panel_5)  # -> epwFile, statFile; plug-in component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
pt_8 = Point(genhbzonetestpts.testPoints)
toggle = BooleanToggle(True)
panel_6 = Panel("""This file shows the results of an office light study.  
It calculates the average daylight factor and the daylight autonomy""")
exporthydra = Hydra_ExportFile(fileName="ligh_study", fileDescription=panel_6, export=Toggle(True))  # -> readMe; inputs fileDescription: list, changeLog: list, fileTags: list, includeRhino: Boolean, GHForThumb: Boolean, additionalImgs: list, export: Boolean; plug-in component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

# ----
# Put the recipie together!
# Daylight Factor Analysis
# Result 3 : average DF
daylighfactorsimulation = Honeybee_DaylightFactorSimulation(
    testPoints=genhbzonetestpts.testPoints,
    ptsVectors=genhbzonetestpts.ptsVectors,
    testMesh=genhbzonetestpts.mesh,
    uniformSky=False)  # -> analysisRecipe; disabled; plug-in component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
panel_7 = Panel("4")  # disabled
rundaylightanalysis = Honeybee_RunDaylightSimulation(
    HBObjects=flatten([createhbsrfs.HBSurface, setradmaterials, brep]),
    analysisRecipe=daylighfactorsimulation,
    writeRad=toggle,
    runRad=toggle,
    numOfCPUs=panel_7,
    overwriteResults=True)  # -> readMe, analysisType, resultsUnit, DF_values, testPts, DF_files, radGeoFile, studyFolder, done; disabled; plug-in component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
number_slider_12 = Slider(1, range=0..10)  # disabled
num = Number(rundaylightanalysis.DF_values)  # disabled
avr = Average(Input=num)  # disabled
number_slider_13 = Slider(6, range=0..10)  # disabled
number_slider_14 = Slider(0, range=0..100)  # disabled
number_slider_15 = Slider(7, range=0..100)  # disabled
gradientlibrary = Ladybug_GradientLibrary(gradIndex=number_slider_12)  # -> customColors; disabled; plug-in component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
panel_8 = Panel(avr)  # disabled
legendpar = Ladybug_LegendParameters(
    lowBound=number_slider_14,
    highBound=number_slider_15,
    numSegments=number_slider_13,
    customColors=flatten(gradientlibrary))  # -> legendPar; disabled; plug-in component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
recolormesh = Ladybug_RecolorMesh(
    analysisResult=rundaylightanalysis.DF_values,
    inputMesh=genhbzonetestpts.mesh,
    legendPar=legendpar,
    analysisTitle=rundaylightanalysis.analysisType,
    legendTitle=rundaylightanalysis.resultsUnit)  # -> readMe, newMesh, newLegend, legendBasePt, meshColors, legendColors; disabled; plug-in component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

toggle_2 = BooleanToggle(False)
captureview = Ladybug_CaptureView(
    fileName="Rhino capture",
    folder="C:\Users\ldantoni\Desktop\Stage\Rhino",
    viewNames="Top",
    imageWidth="600",
    imageHeight="600",
    displayMode="Wireframe",
    keepAspectR=toggle_2,
    transparBack=toggle_2,
    capture=toggle_2)  # -> Output; plug-in component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

# ----
# Result 2 :
# %surface > requirement
# Run the analysis
# Put the recipie together!
# Annual Daylight Analysis
# Result 1 : average DLA
# Generate annual results
# Visualize the results
annualdaylightsimulation = Honeybee_AnnualDaylightSimulation(
    epwWeatherFile=epw_stat.epwFile,
    testPoints=genhbzonetestpts.testPoints,
    ptsVectors=genhbzonetestpts.ptsVectors,
    testMesh=genhbzonetestpts.mesh)  # -> analysisRecipe; plug-in component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
rundaylightanalysis_2 = Honeybee_RunDaylightSimulation(
    HBObjects=flatten([brep, createhbsrfs.HBSurface, setradmaterials]),
    analysisRecipe=annualdaylightsimulation,
    writeRad=toggle,
    runRad=toggle,
    numOfCPUs="4",
    overwriteResults=True)  # -> readMe, analysisType, resultsUnit, results, testPts, annual_analysis_files, radGeoFile, studyFolder, done; plug-in component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
readannualresultsi = Honeybee_ReadAnnualResultI(
    illFilesAddress=rundaylightanalysis_2.annual_analysis_files,
    testPoints=simplify(rundaylightanalysis_2.testPts),
    occupancyFiles=annualschedule.schedule,
    DLAIllumThresholds="300",
    runIt=Toggle(True))  # -> DLA, UDLI_Less_100, UDLI_100_2000, UDLI_More_2000, CDA, sDA, annualProfiles, htmReport; plug-in component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
gradientlibrary_2 = Ladybug_GradientLibrary(gradIndex=Slider(1, range=0..10))  # -> customColors; plug-in component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
avr_2 = Average(Input=readannualresultsi.DLA)
panel_9 = Panel(avr_2)
legendpar_2 = Ladybug_LegendParameters(
    lowBound=Slider(0, range=0..100),
    highBound=Slider(100, range=0..100),
    numSegments=Slider(6, range=0..10),
    customColors=flatten(gradientlibrary_2))  # -> legendPar; plug-in component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
meshselector = Ladybug_MeshThresholdSelector(
    inputMesh=genhbzonetestpts.mesh,
    analysisResult=flatten(readannualresultsi.DLA),
    operator=">=",
    percentToKeep="100",
    levelOfPerform=Slider(30, range=30..50))  # -> readMe, totalValue, areaMeetsThresh, newColoredMesh, newMeshOutline; plug-in component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
area = Area(Geometry=genhbzonetestpts.mesh)  # -> Area, Centroid
division = Division(A=meshselector.areaMeetsThresh, B=area.Area)
panel_10 = Panel(division)
mesh = Mesh(meshselector.newColoredMesh)
crv = Curve(meshselector.newMeshOutline)

# ---- group: make it 3D!
dom = ConstructDomain(DomainStart=0, DomainEnd=Slider(0, range=0..1))

# ----
recolormesh_2 = Ladybug_RecolorMesh(
    analysisResult=readannualresultsi.DLA,
    inputMesh=genhbzonetestpts.mesh,
    heightDomain=dom,
    legendPar=legendpar_2,
    analysisTitle=rundaylightanalysis_2.analysisType,
    legendTitle="%")  # -> readMe, newMesh, newLegend, legendBasePt, meshColors, legendColors; plug-in component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
